# Grasshopper definition Triangulated_dome.gh (Grasshopper 1.0.7)
# plug-ins: Weaverbird

number_slider = Slider(250, range=0..1000)
number_slider_2 = Slider(110, range=0..110)
pt = ConstructPoint(XCoordinate=Slider(21, range=0..100), YCoordinate=0, ZCoordinate=0)
msphereex = MeshSphereEx(Base=PlaneXY(0, 0, 0), Radius=number_slider, Count=Slider(2, range=0..10))
msphereex_2 = MeshSphereEx(Base=pt, Radius=Slider(8, range=0..110), Count=Slider(6, range=0..10))
msplit = MeshSplit(Mesh=flatten(msphereex), Splitters=flatten(msphereex_2))  # -> flatten(Result)
multiplication = Multiplication(A=number_slider, B=2)
area = Area(Geometry=msphereex)  # -> Area, Centroid
box = CenterBox(Base=area.Centroid, X=multiplication, Y=multiplication, Z=Slider(0.01, range=0..0.01))
item = ListItem(List=msplit, Index=Slider(2, range=0..2), Wrap=True)
msplit_2 = MeshSplit(Mesh=item, Splitters=box)
item_2 = ListItem(List=msplit_2, Index=0, Wrap=True)
msplit_3 = MeshSplit(Mesh=flatten(item_2), Splitters=msphereex_2)
qrmesh = QuadRemesh(Mesh=item_2, Settings=Slider(12, range=0..100))
triangulate = GetNumber(Slider(45, range=0..100), AtLeast=1, AtMost=1, Maximum=1.797693135e+308, Minimum=-1.797693135e+308, TreeAccess=False)
wbstellate = WeaverbirdsStellateCumulation(MeshPolylines=qrmesh, Distance=triangulate)
subdivide_triangles = GetNumber(Slider(44, range=0..100), AtLeast=1, AtMost=1, Maximum=1.797693135e+308, Minimum=-1.797693135e+308, TreeAccess=False)
wbstellate_2 = WeaverbirdsStellateCumulation(MeshPolylines=wbstellate, Distance=subdivide_triangles)
panel = Panel("https://energyplus-weather.s3.amazonaws.com/europe_wmo_region_6/ESP/ESP_Barcelona.081810_SWEC/ESP_Barcelona.081810_SWEC.zip")
inflate_triangles = GetNumber(Slider(2, range=0..100), AtLeast=1, AtMost=1, Maximum=1.797693135e+308, Minimum=-1.797693135e+308, TreeAccess=False)
panel_openings = GetInteger(Slider(38, range=15..50), AtLeast=1, AtMost=1, Maximum=2147483647, Minimum=-2147483648, TreeAccess=False)
downloadepw = LBDownloadWeather(weather_URL=panel)  # -> epw_file, stat_file, ddy_file; plug-in component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
wbstellate_3 = WeaverbirdsStellateCumulation(MeshPolylines=wbstellate_2, Distance=inflate_triangles)
dom = ConstructDomain(DomainStart=Slider(0, range=0..1), DomainEnd=panel_openings)
bnd = Bounds(Numbers=wbstellate_3)
importepw = LBImportEPW(epw_file=downloadepw.epw_file)  # -> location, dry_bulb_temperature, dew_point_temperature, relative_humidity, wind_speed, wind_direction, direct_normal_rad, diffuse_horizontal_rad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; plug-in component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
remap = RemapNumbers(Value=wbstellate_3, Source=bnd, Target=dom)  # -> Mapped, Clipped
skymatrix = LBCumulativeSkyMatrix()  # -> report, sky_mtx; plug-in component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
wbframe = WeaverbirdsPictureFrame(MeshPolylines=wbstellate_3, Distance=remap.Mapped, InsetType=Slider(0, range=0..1))
number_slider_3 = Slider(1, range=1..12)
number_slider_4 = Slider(9, range=9..18)
number_slider_5 = Slider(21, range=0..100)
analysisperiod = LBAnalysisPeriod(
    start_month=number_slider_3,
    start_day=number_slider_5,
    start_hour=number_slider_4,
    end_month=number_slider_3,
    end_day=number_slider_5,
    end_hour=number_slider_4)  # -> period, hoys, dates; plug-in component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
compass = LBCompass(scale=Slider(31, range=0..100))  # -> compass; plug-in component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
sunpath = LBSunPath(location=importepw.location, hoys=analysisperiod.hoys, scale=1)  # -> report, vectors, altitudes, azimuths, hoys, sun_pts, analemma, daily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; plug-in component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
context_bake = ContextBake(Geometry=compass)
get_boolean = GetBoolean(Toggle(False), AtLeast=1, AtMost=1, FalseValue="False", TreeAccess=False, TrueValue="True")
directsunhours = LBDirectSunHours(vectors=flatten(sunpath.vectors), geometry=flatten(wbframe), grid_size="1", run=get_boolean)  # -> report, points, results, mesh, legend, title, int_mtx; plug-in component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
mesh = Mesh(directsunhours.mesh)
data = Data([directsunhours.legend, directsunhours.title])
ma = MassAddition(Input=directsunhours.results)  # -> Result, PartialResults
context_bake_2 = ContextBake(Geometry=mesh)
context_bake_3 = ContextBake(Geometry=data)
panel_2 = Panel(ma.Result)
