# Grasshopper definition kineticf.gh (Grasshopper 1.0.7)
# plug-ins: LunchBox

number_slider = Slider(0, range=0..10)
number_slider_2 = Slider(5, range=0..8)

number_of_waves = GetInteger(Slider(3, range=0..3), AtLeast=1, AtMost=1, Maximum=2147483647, Minimum=-2147483648, TreeAccess=False)
curve_depht = GetNumber(Slider(0.8, range=0..1), AtLeast=1, AtMost=1, Maximum=1.797693135e+308, Minimum=-1.797693135e+308, TreeAccess=False)
curve_variation = GetNumber(Slider(0.1, range=0..1.5), AtLeast=1, AtMost=1, Maximum=1.797693135e+308, Minimum=-1.797693135e+308, TreeAccess=False)

subtraction = Subtraction(A=Slider(16, range=0..100), B=number_slider)
pi = Pi(Factor=curve_variation)
pi_2 = Pi(Factor=number_of_waves)
dom = ConstructDomain(DomainStart=number_slider, DomainEnd=subtraction)
dom_2 = ConstructDomain(DomainStart=pi, DomainEnd=pi_2)
range = Range(Domain=dom, Steps=10)
range_2 = Range(Domain=dom_2, Steps=10)
X = UnitX(Factor=expr("-x", number_slider_2))
X_2 = UnitX(Factor=number_slider_2)
sin = Sine(Value=range_2)
division = Division(A=Slider(9, range=0..25), B=2)
merge = Merge(Data1=X_2, Data2=X)
multiplication = Multiplication(A=sin, B=curve_depht)
addition = Addition(A=division, B=multiplication)
pt = ConstructPoint(XCoordinate=addition, YCoordinate=range, ZCoordinate=0)
intcrv = Interpolate(Vertices=pt, Degree=3, Periodic=False, KnotStyle=1)  # -> Curve, Length, Domain
move = Move(Geometry=intcrv.Curve, Motion=merge)  # -> Geometry, Transform

multiplication_2 = Multiplication(A=Slider(2, range=0..10), B=Slider(3, range=0..10))
Z = UnitZ(Factor=multiplication_2)

number_slider_3 = Slider(0, range=0..10)  # disabled
number_slider_4 = Slider(0.1, range=0..3)  # disabled
number_slider_5 = Slider(4, range=0..4)  # disabled
number_slider_6 = Slider(1.7, range=0..2)  # disabled
number_slider_7 = Slider(6.8, range=0..8)  # disabled

number_slider_8 = Slider(5.1, range=0..10)  # disabled
number_slider_9 = Slider(3, range=0..10)  # disabled
number_slider_10 = Slider(1, range=0..1)  # disabled

number_slider_11 = Slider(14, range=0..25)  # disabled
number_slider_12 = Slider(40, range=0..100)  # disabled
number_of_waves_0_4 = GetInteger(number_slider_5, AtLeast=1, AtMost=1, Maximum=2147483647, Minimum=-2147483648, TreeAccess=False)  # disabled
curve_depht_0_1_2_0 = GetNumber(number_slider_6, AtLeast=1, AtMost=1, Maximum=1.797693135e+308, Minimum=-1.797693135e+308, TreeAccess=False)  # disabled
curve_variation_0_1_3_0 = GetNumber(number_slider_4, AtLeast=1, AtMost=1, Maximum=1.797693135e+308, Minimum=-1.797693135e+308, TreeAccess=False)  # disabled

move_2 = Move(Geometry=move.Geometry, Motion=Z)  # -> Geometry, Transform
item = ListItem(List=move.Geometry, Index=0, Wrap=True)  # -> Item, Item1
item_2 = ListItem(List=move_2.Geometry, Index=0, Wrap=True)  # -> Item, Item1

geo = Geometry(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)

subtraction_2 = Subtraction(A=number_slider_12, B=number_slider_3)  # disabled
pi_3 = Pi(Factor=curve_variation_0_1_3_0)  # disabled
pi_4 = Pi(Factor=number_of_waves_0_4)  # disabled
dom_3 = ConstructDomain(DomainStart=number_slider_3, DomainEnd=subtraction_2)  # disabled
dom_4 = ConstructDomain(DomainStart=pi_3, DomainEnd=pi_4)  # disabled
range_3 = Range(Domain=dom_3, Steps=10)  # disabled
range_4 = Range(Domain=dom_4, Steps=10)  # disabled
X_3 = UnitX(Factor=expr("-x", number_slider_7))  # disabled
X_4 = UnitX(Factor=number_slider_7)  # disabled
sin_2 = Sine(Value=range_4)  # disabled
division_2 = Division(A=number_slider_11, B=2)  # disabled
merge_2 = Merge(Data1=X_4, Data2=X_3)  # disabled
multiplication_3 = Multiplication(A=sin_2, B=curve_depht_0_1_2_0)  # disabled
addition_2 = Addition(A=division_2, B=multiplication_3)  # disabled
pt_2 = ConstructPoint(XCoordinate=addition_2, YCoordinate=range_3, ZCoordinate=0)  # disabled
intcrv_2 = Interpolate(Vertices=pt_2, Degree=3, Periodic=False, KnotStyle=1)  # -> Curve, Length, Domain; disabled
move_3 = Move(Geometry=intcrv_2.Curve, Motion=merge_2)  # -> Geometry, Transform; disabled

multiplication_4 = Multiplication(A=number_slider_8, B=number_slider_9)  # disabled
subtraction_3 = Subtraction(A=multiplication_4, B=number_slider_10)  # disabled
Z_2 = UnitZ(Factor=expr("x-1", multiplication_4))  # disabled
Z_3 = UnitZ(Factor=multiplication_4)  # disabled
Z_4 = UnitZ(Factor=1)  # disabled
merge_3 = Merge(Data1=Z_4, Data2=Z_2)  # disabled

edges = BrepEdges(Brep=geo)  # -> Naked, Interior, NonManifold
item_3 = ListItem(List=edges.Naked, Index=0, Wrap=True)  # -> Item, Item1, Item2, Item3, Item4

loft = Loft(
    Curves=[item.Item, item_2.Item],
    Options={Adjust=False, Closed=False, LoftEnds=0, LoftSimp=0, LoftType=0, Rebuild=10, Refit=0.01})
loft_2 = Loft(
    Curves=[item.Item1, item_2.Item1],
    Options={Adjust=False, Closed=False, LoftEnds=0, LoftSimp=0, LoftType=0, Rebuild=10, Refit=0.01})
loft_3 = Loft(
    Curves=[item_2.Item, item_2.Item1],
    Options={Adjust=False, Closed=False, LoftEnds=0, LoftSimp=0, LoftType=0, Rebuild=10, Refit=0.01})
neg = Negative(Value=Slider(0.5, range=0..1))
merge_4 = Merge(Data1=loft_3, Data2=loft, Data3=loft_2)
offset = OffsetSurface(Surface=loft, Distance=neg, Retrim=True)
offset_2 = OffsetSurface(Surface=loft_3, Distance=neg, Retrim=True)

end = EndPoints(Curve=item_3.Item)  # -> Start, End
end_2 = EndPoints(Curve=item_3.Item2)  # -> Start, End
ln = Line(StartPoint=end.Start, EndPoint=end.End)
ln_2 = Line(StartPoint=end_2.Start, EndPoint=end_2.End)

loft_4 = Loft(
    Curves=[item.Item, item.Item1],
    Options={Adjust=False, Closed=False, LoftEnds=0, LoftSimp=0, LoftType=0, Rebuild=10, Refit=0.01})
debrep = DeconstructBrep(Brep=loft_2)  # -> Faces, Edges, Vertices
debrep_2 = DeconstructBrep(Brep=loft)  # -> Faces, Edges, Vertices
panel = Panel("""0
2""")
panel_2 = Panel("""0
2""")
item_4 = ListItem(List=flatten(debrep.Edges), Index=panel, Wrap=True)
item_5 = ListItem(List=flatten(debrep_2.Edges), Index=panel_2, Wrap=True)
rulesrf = RuledSurface(CurveA=item_5, CurveB=item_4)
merge_5 = Merge(Data1=loft_4, Data2=rulesrf)
mcol = MeshColours(Mesh=merge_5, Colours=ColourSwatch(SwatchColor=RGB(217, 217, 217)))

join = JoinCurves(Curves=[item_3.Item2, ln_2], Preserve=False)
join_2 = JoinCurves(Curves=[item_3.Item, ln], Preserve=False)
boundary = BoundarySurfaces(Edges=join_2)
boundary_2 = BoundarySurfaces(Edges=join)

neg_2 = Negative(Value=Slider(0.6, range=0..1))
offset_3 = OffsetSurface(Surface=geo, Distance=neg_2, Retrim=True)
geo_2 = Geometry(Tree({0}: [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], {1}: [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], {2}: [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], {3}: [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], {4}: [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], {5}: [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]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))  # disabled
geo_3 = Geometry([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])
mcol_2 = MeshColours(Mesh=graft(geo), Colours=graft(ColourSwatch(SwatchColor=RGBA(118, 161, 168, 118))))
mcol_3 = MeshColours(Mesh=graft([geo_3, boundary, boundary_2]), Colours=graft(ColourSwatch(SwatchColor=RGB(255, 255, 255))))
context_bake = ContextBake(Geometry=flatten([mcol_3, mcol_2]))

move_4 = Move(Geometry=move_3.Geometry, Motion=graft(merge_3))  # -> flatten(Geometry), Transform; disabled
move_5 = Move(Geometry=move_3.Geometry, Motion=Z_3)  # -> Geometry, Transform; disabled
item_6 = ListItem(List=move_3.Geometry, Index=0, Wrap=True)  # -> Item, Item1; disabled
item_7 = ListItem(List=move_5.Geometry, Index=0, Wrap=True)  # -> Item, Item1; disabled
item_8 = ListItem(List=move_4.Geometry, Index=0, Wrap=True)  # -> Item, Item1, Item2, Item3; disabled
tweencrv = TweenCurve(CurveA=item_7.Item, CurveB=item_7.Item1, Factor=0.5, BlendType=0)  # disabled

number_slider_13 = Slider(0.8, range=0..10)  # disabled
number_slider_14 = Slider(0.8, range=0..10)  # disabled
number_slider_15 = Slider(2, range=0..10)  # disabled
multiplication_5 = Multiplication(A=number_slider_14, B=number_slider_15)  # disabled
neg_3 = Negative(Value=number_slider_13)  # disabled

merge_6 = Merge(
    Data1=flatten(item_6.Item),
    Data2=flatten(item_8.Item),
    Data3=flatten(item_8.Item2),
    Data4=flatten(item_7.Item),
    Data5=flatten(tweencrv),
    Data6=flatten(item_7.Item1),
    Data7=flatten(item_8.Item3),
    Data8=flatten(item_8.Item1),
    Data9=flatten(item_6.Item1))  # -> flatten(Result); disabled
loft_5 = Loft(Curves=merge_6, Options={Adjust=True, Closed=False, LoftEnds=0, LoftSimp=0, LoftType=1, Rebuild=6, Refit=0.01})  # disabled

pt_3 = ConstructPoint(XCoordinate=0, YCoordinate=0, ZCoordinate=neg_3)  # disabled
pt_4 = ConstructPoint(XCoordinate=0, YCoordinate=0, ZCoordinate=multiplication_5)  # disabled
pt_5 = ConstructPoint(XCoordinate=0, YCoordinate=0, ZCoordinate=number_slider_14)  # disabled
merge_7 = Merge(Data1=pt_3, Data2=pt_5, Data3=pt_4)  # disabled

number_slider_16 = Slider(1, range=0..1)  # disabled
dom_5 = ConstructDomain(DomainStart=number_slider_16, DomainEnd=subtraction_3)  # disabled
range_5 = Range(Domain=dom_5, Steps=number_slider_9)  # disabled
expression = Expression(x=range_5, Expression="Round(x,2)")  # disabled
xy = XYPlane(Origin=merge_7)  # disabled
Z_5 = UnitZ(Factor=expression)  # disabled
move_6 = Move(Geometry=xy, Motion=Z_5)  # -> Geometry, Transform; disabled
sec = BrepPlane(Brep=loft_5, Plane=move_6.Geometry)  # -> Curves, Points; disabled
crv = Curve(sec.Curves)  # disabled
loft_6 = Loft(Curves=crv, Options={Adjust=True, Closed=False, LoftEnds=0, LoftSimp=0, LoftType=3, Rebuild=10, Refit=0.01})  # disabled

data = Data(multiplication_4)  # disabled
deconstruct_plane = DeconstructPlane(Plane=move_6.Geometry)  # -> Origin, XAxis, YAxis, ZAxis; disabled
edges_2 = BrepEdges(Brep=loft_5)  # -> Naked, Interior, NonManifold; disabled
syncghfile = LBSyncGrasshopperFile(sync=Toggle(True))  # -> report; plug-in component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
panel_3 = Panel("""1
3""")  # disabled
panel_4 = Panel("""0
2""")  # disabled
deconstruct = Deconstruct(Point=deconstruct_plane.Origin)  # -> XComponent, YComponent, ZComponent; disabled
item_9 = ListItem(List=edges_2.Naked, Index=panel_3, Wrap=True)  # disabled
item_10 = ListItem(List=edges_2.Naked, Index=panel_4, Wrap=True)  # disabled
panel_5 = Panel(syncghfile)
loft_7 = Loft(Curves=item_9, Options={Adjust=True, Closed=False, LoftEnds=0, LoftSimp=0, LoftType=2, Rebuild=10, Refit=0.01})  # disabled
smaller_than = SmallerThan(FirstNumber=deconstruct.ZComponent, SecondNumber=data)  # -> SmallerThan, OrEqualTo; disabled
item_11 = ListItem(List=item_10, Index=0, Wrap=True)  # -> Item, Item1; disabled
end_3 = EndPoints(Curve=item_11.Item)  # -> Start, End; disabled
end_4 = EndPoints(Curve=item_11.Item1)  # -> Start, End; disabled
boolean_toggle = BooleanToggle(True)  # disabled
boolean_toggle_2 = BooleanToggle(False)  # disabled
loft_8 = Loft(Curves=move_3.Geometry, Options={Adjust=False, Closed=False, LoftEnds=0, LoftSimp=0, LoftType=0, Rebuild=10, Refit=0.01})  # disabled
dispatch = Dispatch(List=move_6.Geometry, DispatchPattern=smaller_than.SmallerThan)  # -> ListA, ListB; disabled
ln_3 = Line(StartPoint=end_3.Start, EndPoint=end_3.End)  # disabled
ln_4 = Line(StartPoint=end_4.Start, EndPoint=end_4.End)  # disabled
panel_6 = Panel("0.3")  # disabled
join_3 = JoinCurves(Curves=[ln_3, item_11.Item], Preserve=False)  # disabled
join_4 = JoinCurves(Curves=[item_11.Item1, ln_4], Preserve=False)  # disabled
move_to_plane = MoveToPlane(Geometry=loft_8, Plane=dispatch.ListA, Above=boolean_toggle_2, Below=boolean_toggle)  # -> Geometry, Transform; disabled
unit_z = UnitZ(Factor=expr("-x", panel_6))  # disabled
boundary_3 = BoundarySurfaces(Edges=join_3)  # disabled
boundary_4 = BoundarySurfaces(Edges=join_4)  # disabled
number_slider_17 = Slider(0.3, range=0..1)  # disabled
extrude = Extrude(Base=move_to_plane.Geometry, Direction=unit_z)  # disabled

cull_i = CullIndex(List=flatten(loft_6), Indices=-1, Wrap=True)  # disabled

Z_6 = UnitZ(Factor=expr("-x", number_slider_17))  # disabled
extr = Extrude(Base=cull_i, Direction=Z_6)  # disabled
merge_8 = Merge(Data1=loft_5, Data2=boundary_3, Data3=boundary_4, Data4=loft_7)  # disabled
number_slider_18 = Slider(0.1, range=0..1)  # disabled
number_slider_19 = Slider(22, range=1..50)  # disabled
offset_surface = OffsetSurface(Surface=loft_5, Distance=number_slider_18, Retrim=True)  # disabled
quad_panels = QuadPanels(Surface=loft_5, UDivisions=number_slider_19, VDivisions=number_slider_19)  # disabled
quad_panels_2 = QuadPanels(Surface=offset_surface, UDivisions=number_slider_19, VDivisions=number_slider_19)  # disabled
panel_7 = Panel("0.9")  # disabled
panel_frame = PanelFrame(Panel=quad_panels, ScaleFactor=panel_7)  # -> PanelFrame, Panel; disabled
panel_frame_2 = PanelFrame(Panel=quad_panels_2, ScaleFactor=panel_7)  # -> PanelFrame, Panel; disabled
brep_edges = BrepEdges(Brep=panel_frame.PanelFrame)  # -> flatten(Naked), Interior, NonManifold; disabled
brep_edges_2 = BrepEdges(Brep=panel_frame_2.PanelFrame)  # -> flatten(Naked), Interior, NonManifold; disabled
merge_9 = Merge(Data1=graft(brep_edges.Naked), Data2=graft(brep_edges_2.Naked))  # disabled
swatch = ColourSwatch(SwatchColor=RGBA(75, 178, 160, 132))  # disabled
loft_9 = Loft(Curves=merge_9, Options={Adjust=False, Closed=False, LoftEnds=0, LoftSimp=0, LoftType=0, Rebuild=10, Refit=0.01})  # disabled
mesh = Mesh(extrude)  # disabled
swatch_2 = ColourSwatch(SwatchColor=RGBA(43, 43, 43, 179))  # disabled
# need to convert to mesh!
mesh_2 = Mesh([loft_9, extrude])  # disabled
mesh_colours = MeshColours(Mesh=mesh_2, Colours=swatch_2)  # disabled
context_bake_2 = ContextBake(Geometry=flatten(mesh_colours))  # disabled

panel_8 = Panel("https://energyplus-weather.s3.amazonaws.com/europe_wmo_region_6/ESP/ESP_Barcelona.081810_SWEC/ESP_Barcelona.081810_SWEC.zip")
downloadepw = LBDownloadWeather(weather_URL=panel_8)  # -> epw_file, stat_file, ddy_file; plug-in component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
month = GetInteger(Slider(7, range=1..12), AtLeast=1, AtMost=1, Maximum=2147483647, Minimum=-2147483648, TreeAccess=False)
day = GetInteger(Slider(20, range=1..30), AtLeast=1, AtMost=1, Maximum=2147483647, Minimum=-2147483648, TreeAccess=False)
hour = GetInteger(Slider(10, range=7..19), AtLeast=1, AtMost=1, Maximum=2147483647, Minimum=-2147483648, TreeAccess=False)
importepw = LBImportEPW(epw_file=downloadepw.epw_file)  # -> location, dry_bulb_temperature, dew_point_temperature, relative_humidity, wind_speed, wind_direction, direct_normal_rad, diffuse_horizontal_rad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; plug-in component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
analysisperiod = LBAnalysisPeriod(start_month=month, start_day=day, start_hour=hour, end_month=month, end_day=day, end_hour=hour)  # -> period, hoys, dates; plug-in component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
get_boolean = GetBoolean(Toggle(True), AtLeast=1, AtMost=1, FalseValue="False", TreeAccess=False, TrueValue="True")

# ---- group: There is a change in the input or output! Replace this component manually.
sunpath = LBSunPath(location=importepw.location, hoys=analysisperiod.hoys, scale=1)  # -> report, vectors, altitudes, azimuths, hoys, sun_pts, analemma, daily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; plug-in component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

# ----
cluster = Cluster(uv=sunpath.vectors, srf=offset)
cluster_2 = Cluster(uv=sunpath.vectors, srf=offset_2)
mcol_4 = MeshColours(Mesh=merge_4, Colours=ColourSwatch(SwatchColor=RGBA(105, 159, 184, 147)))
weld = WeldMesh(Mesh=flatten([cluster, cluster_2]), Angle=3.141592654)

skymatrix = LBCumulativeSkyMatrix(
    location=importepw.location,
    direct_rad=importepw.direct_normal_rad,
    diffuse_rad=importepw.diffuse_horizontal_rad,
    hoys=analysisperiod.hoys)  # -> report, sky_mtx; plug-in component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

item_12 = ListItem(List=weld, Index=0, Wrap=True)
lng = ListLength(List=weld)
area = Area(Geometry=item_12)  # -> Area, Centroid
number_of_panels = Panel(lng)
area_of_each_panel = Panel(area.Area)
context_print = ContextPrint(NumberOfPanels=number_of_panels)
context_print_2 = ContextPrint(AreaPerPanel=area_of_each_panel)
context_bake_3 = ContextBake(Geometry=mcol)
context_bake_4 = ContextBake(Geometry=mcol_4)

# ---- group: There is a change in the input or output! Replace this component manually.
incidentradiation = LBIncidentRadiation(sky_mtx=skymatrix.sky_mtx, geometry=flatten(weld), grid_size="1.3", offset_dist=".1", run=get_boolean)  # -> report, points, results, total, mesh, legend, title, int_mtx; plug-in component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

# ----
rtrad = LBRealTimeIncidentRadiation(int_mtx=incidentradiation.int_mtx, sky_mtx=skymatrix.sky_mtx)  # -> results; plug-in component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
ma = MassAddition(Input=rtrad)  # -> Result, PartialResults
area_2 = Area(Geometry=incidentradiation.mesh)  # -> Area, Centroid
division_3 = Division(A=area_2.Area, B="176.6")
division_4 = Division(A=ma.Result, B=division_3)
total_incident_sun_hours_in_kwh_m2 = Panel(ma.Result)
total_area_of_photovoltaics_m2 = Panel(area_2.Area)
total_energy_production_kw_h = Panel(division_4)
context_print_3 = ContextPrint(TotalIncidentSunHoursInKwhM2=total_incident_sun_hours_in_kwh_m2)
context_print_4 = ContextPrint(TotalAreaOfPhotovoltaicsM2=total_area_of_photovoltaics_m2)
context_print_5 = ContextPrint(TotalEnergyProductionKWH=total_energy_production_kw_h)
context_bake_5 = ContextBake(Geometry=flatten(incidentradiation.mesh))

number_slider_20 = Slider(1.6, range=0..10)  # disabled
debrep_3 = DeconstructBrep(Brep=loft_5)  # -> Faces, Edges, Vertices; disabled
dim = Dimensions(Surface=debrep_3.Faces)  # -> UDimension, VDimension; disabled
integer_division = IntegerDivision(A=dim.VDimension, B=number_slider_20)  # disabled
integer_division_2 = IntegerDivision(A=dim.UDimension, B=number_slider_20)  # disabled
number_slider_21 = Slider(0.1, range=0..0.1)  # disabled
divide = DivideDomain²(Domain=debrep_3.Faces, UCount=integer_division_2, VCount=integer_division)  # disabled
subsrf = Isotrim(Surface=graft(debrep_3.Faces), Domain=divide)  # disabled
offsets = OffsetOnSrf(Curve=subsrf, Distance=number_slider_21, Surface=subsrf)  # disabled
area_3 = Area(Geometry=subsrf)  # -> Area, Centroid; disabled
crv_2 = Curve(subsrf)  # disabled
crv_3 = Curve(offsets)  # disabled
number_slider_22 = Slider(0.07, range=0..0.1)  # disabled
evalsrf = EvaluateSurface(Surface=subsrf, Point=area_3.Centroid)  # -> Point, Normal, UDirection, VDirection, Frame; disabled
merge_10 = Merge(Data1=graft(crv_2), Data2=crv_3)  # disabled
loft_10 = Loft(Curves=merge_10, Options={Adjust=False, Closed=False, LoftEnds=0, LoftSimp=0, LoftType=0, Rebuild=10, Refit=0.01})  # -> graft(Loft); disabled

rev = Reverse(Vector=evalsrf.Normal)  # disabled

amp = Amplitude(Vector=rev, Amplitude=expr("x/2", number_slider_22))  # -> graft(Vector); disabled
amp_2 = Amplitude(Vector=rev, Amplitude=number_slider_22)  # -> graft(Vector); disabled
move_7 = Move(Geometry=crv_3, Motion=amp)  # -> Geometry, Transform; disabled
extr_2 = Extrude(Base=loft_10, Direction=amp_2)  # -> simplify(Extrusion); disabled

preview = CustomPreview(Geometry=move_7.Geometry, Material=swatch)  # disabled

# ==== cluster Cluster
uv = ClusterInput()
srf = ClusterInput()
Z = UnitZ(Factor=Slider(0.1, range=0..0.1))

number_slider = Slider(14, range=0..50)
number_slider_2 = Slider(6, range=0..50)
rebuildsrf = RebuildSurface(Surface=srf, UDegree=2, VDegree=2, UNumber=number_slider_2, VNumber=number_slider)
srf_2 = Surface(rebuildsrf)
evalsrf = EvaluateSurface(Surface=reparameterize(srf_2), Point=uv)  # -> Point, Normal, UDirection, VDirection, Frame
divide = DivideDomain²(Domain=rebuildsrf, UCount=number_slider_2, VCount=number_slider)
subsrf = Isotrim(Surface=rebuildsrf, Domain=divide)
debrep = DeconstructBrep(Brep=subsrf)  # -> Faces, Edges, Vertices
nurbs = NurbsCurve(Vertices=debrep.Vertices, Degree=3, Periodic=invert(False))  # -> Curve, Length, Domain
divide_2 = DivideCurve(Curve=nurbs.Curve, Count=10, Kinks=False)  # -> Points, Tangents, Parameters
number_slider_3 = Slider(2, range=0..10)
expression = Expression(x=divide_2.Points, Expression="round(x,3)")  # disabled
fcircle = CircleFit(Points=divide_2.Points)  # -> flatten(Circle), flatten(Radius), Deviation
planar = Planar(Curve=fcircle.Circle)  # -> Planar, Plane, Deviation
pt = Point(planar.Plane)
srf_cp = SurfaceClosestPoint(Point=pt, Surface=rebuildsrf)  # -> Point, UVPoint, Distance
evalsrf_2 = EvaluateSurface(Surface=rebuildsrf, Point=srf_cp.UVPoint)  # -> Point, Normal, UDirection, VDirection, Frame

cir = Circle(Plane=evalsrf.Frame, Radius=Slider(0.3, range=0..1))

planar_2 = Planar(Curve=cir)  # -> Planar, Plane, Deviation
fspin = SpinForce(Plane=planar_2.Plane, Strength=1, Radius=Slider(56, range=0..100), Decay=2)
mergef = MergeFields(Fields=fspin)
evf = EvaluateField(Field=mergef, Point=pt)  # -> Tensor, Strength
angle = Angle(VectorA=evalsrf_2.UDirection, VectorB=evf.Tensor, Plane=evalsrf_2.Frame)  # -> Angle, Reflex
rot3d = Rotate3D(Geometry=fcircle.Circle, Angle=angle.Angle, Center=evalsrf_2.Point, Axis=evalsrf_2.VDirection)  # -> Geometry, Transform
boundary = BoundarySurfaces(Edges=rot3d.Geometry)

extr = Extrude(Base=boundary, Direction=Z)
mesh = Mesh(extr)
mesh_2 = ClusterOutput(mesh)
