# Grasshopper definition wing_pavilion.gh (Grasshopper 1.0.7)

wing_height = GetInteger(Slider(300, range=50..300), AtLeast=1, AtMost=1, Maximum=2147483647, Minimum=-2147483648, TreeAccess=False)
side_height = GetInteger(Slider(25, range=0..160), AtLeast=1, AtMost=1, Maximum=2147483647, Minimum=-2147483648, TreeAccess=False)
yz = YZPlane(Origin=Point(0, 0, 0))
xz = XZPlane(Origin=Point(0, 0, 0))
ellipse = Ellipse(Plane=yz, Radius1=Slider(40, range=40..200), Radius2=side_height)  # -> Ellipse, Focus1, Focus2
length = GetInteger(Slider(-300, range=-500..500), AtLeast=1, AtMost=1, Maximum=2147483647, Minimum=-2147483648, TreeAccess=False)
ellipse_2 = Ellipse(Plane=xz, Radius1=wing_height, Radius2=Slider(224, range=0..400))  # -> Ellipse, Focus1, Focus2
Y = UnitY(Factor=length)
move = Move(Geometry=ellipse.Ellipse, Motion=Y)  # -> Geometry, Transform
rotate = Rotate(Geometry=ellipse_2.Ellipse, Angle=degrees(Slider(120, range=120..200)), Plane=xz)  # -> Geometry, Transform
opening_direction_01 = GetNumber(Slider(0.34, range=0..1), AtLeast=1, AtMost=1, Maximum=1.797693135e+308, Minimum=-1.797693135e+308, TreeAccess=False)
vec = VectorXYZ(XComponent=Slider(-239, range=-300..300), YComponent=0, ZComponent=Slider(-62, range=-300..300))  # -> Vector, Length
dom = ConstructDomain(DomainStart=opening_direction_01, DomainEnd=Slider(0.7, range=0..1))
subcrv = SubCurve(BaseCurve=reparameterize(move.Geometry), Domain=dom)
crease_depth = GetNumber(
    Slider(0.88, range=0.8..0.98),
    AtLeast=1,
    AtMost=1,
    Maximum=1.797693135e+308,
    Minimum=-1.797693135e+308,
    TreeAccess=False)
opening_direction_02 = GetNumber(Slider(0.82, range=0..1), AtLeast=1, AtMost=1, Maximum=1.797693135e+308, Minimum=-1.797693135e+308, TreeAccess=False)
move_2 = Move(Geometry=rotate.Geometry, Motion=vec.Vector)  # -> Geometry, Transform
crease_frequency = GetInteger(Slider(14, range=8..20), AtLeast=1, AtMost=1, Maximum=2147483647, Minimum=-2147483648, TreeAccess=False)
divide = DivideCurve(Curve=subcrv, Count=crease_frequency, Kinks=False)  # -> Points, Tangents, Parameters
num = Number(flatten([crease_depth, Slider(1, range=0..1)]))
dom_2 = ConstructDomain(DomainStart=Slider(1, range=0..1), DomainEnd=opening_direction_02)
subcrv_2 = SubCurve(BaseCurve=reparameterize(move_2.Geometry), Domain=dom_2)
xz_2 = XZPlane(Origin=Point(0, 0, 0))
area = Area(Geometry=move_2.Geometry)  # -> Area, Centroid
repeat = RepeatData(Data=num, Length=crease_frequency)
divide_2 = DivideCurve(Curve=subcrv_2, Count=crease_frequency, Kinks=False)  # -> Points, Tangents, Parameters
mirror = Mirror(Geometry=divide.Points, Plane=xz_2)  # -> Geometry, Transform
scale = Scale(Geometry=divide_2.Points, Center=area.Centroid, Factor=repeat)  # -> Geometry, Transform
yz_2 = YZPlane(Origin=Point(0, 0, 0))
mirror_2 = Mirror(Geometry=scale.Geometry, Plane=yz_2)  # -> Geometry, Transform
merge = Merge(Data1=graft(mirror_2.Geometry), Data2=graft(mirror.Geometry), Data3=graft(scale.Geometry), Data4=graft(divide.Points))
intcrv = Interpolate(Vertices=merge, Degree=3, Periodic=invert(False), KnotStyle=1)  # -> Curve, Length, Domain
loft = Loft(
    Curves=flatten(intcrv.Curve),
    Options={Adjust=True, Closed=False, LoftEnds=0, LoftSimp=0, LoftType=2, Rebuild=10, Refit=0.01})
qrmesh = QuadRemesh(Mesh=loft, Settings=Slider(10000, range=0..10000))  # -> flatten(QuadResult)
mcol = MeshColours(Mesh=qrmesh, Colours=ColourSwatch(SwatchColor=RGBA(148, 12, 125, 139)))
context_bake = ContextBake(Geometry=mcol)
